# Grasshopper definition GrasshopperToPython.gh (Grasshopper 1.0.7)

number_slider = Slider(10, range=0..10)
series = Series(Start=0, Step=1, Count=10)
# 1. list
series_2 = Series(Start=0, Step=1, Count=10)
series_3 = Series(Start=0, Step=1, Count=graft(series))

# ---- group: ghpythonlib treehelpers
python = GhPythonScript(x=series_3)  # -> out, a; inputs x: tree
# ---------- python: Python ----------
import ghpythonlib.treehelpers as th

#list of list
lists = [ [1,2,3] , [4,5,6]]

a = th.list_to_tree(lists)

#convert a tree to a list
#print th.tree_to_list(x)

#iterate through a tree
for branch in range(x.BranchCount):
    print x.Branch(branch)
# ---------- end python ----------

# ---- group: ghpythonlib components
python_2 = GhPythonScript(y=number_slider)  # -> out, a, b, c; inputs y: Int32
# ---------- python_2: Python ----------
import ghpythonlib.components as comp

#node in code
S = comp.Series(0, 1, 10)

ptList1 = comp.ConstructPoint(S, 0, 0)
ptList2 = comp.ConstructPoint(S, y, 0)

lines = comp.Line(ptList1, ptList2)

a = ptList1
b = ptList2
c = lines

#complete the definition....
# ---------- end python_2 ----------

# ----
panel = Panel(series_2)
# 2. points
pt = ConstructPoint(XCoordinate=series_2, YCoordinate=0, ZCoordinate=0)
pt_2 = ConstructPoint(XCoordinate=series_2, YCoordinate=number_slider, ZCoordinate=0)
panel_2 = Panel(python.a)
# 3. line
ln = Line(StartPoint=pt, EndPoint=pt_2)
# 4. divide curve
divide = DivideCurve(Curve=ln, Count=10, Kinks=False)  # -> Points, Tangents, Parameters
vec = Vector(divide.Points)
vlen = VectorLength(Vector=vec)
sin = Sine(Value=vlen)
Z = UnitZ(Factor=sin)
# 5. vector
move = Move(Geometry=divide.Points, Motion=Z)  # -> Geometry, Transform
# 6. curve
intcrv = Interpolate(Vertices=move.Geometry, Degree=3, Periodic=False, KnotStyle=1)  # -> Curve, Length, Domain
# 7. surface
loft = Loft(
    Curves=flatten(intcrv.Curve),
    Options={Adjust=False, Closed=False, LoftEnds=0, LoftSimp=0, LoftType=0, Rebuild=10, Refit=0.01})
# 8. mesh
mesh_uv = MeshSurface(Surface=loft, UCount=Slider(10, range=0..10), VCount=Slider(7, range=0..10), Overhang=True, Equalize=False)
